% Simulink data dictionary Navigation.sldd

starTracker_meas = Simulink.Bus()  % star tracker measurements bus
  timestamp: double, Unit="sec"  % measure timestamp
  quaternion: double[4 1]  % measured quaternion

IMU_meas = Simulink.Bus()  % IMU measurements
  acc_timestamp: double, Unit="sec"  % timestamp of acceleration measurement
  gyro_timestamp: double, Unit="sec"  % timestamp of gyroscope measurement
  acc: double[3 1], Unit="m/s^2"  % measured acceleration
  gyro: double[3 1], Unit="rad/s"  % measured angular rates

Measurements = Simulink.Bus()  % Bus containing all the measurements
  IMU: Bus: IMU_meas
  starTracker: Bus: starTracker_meas